# Grasshopper definition force simulation_ice.gh (Grasshopper 1.0.4)
# plug-ins: Human, Kangaroo Components

crv = Curve([<curve referenced from the Rhino model> x5])
cp = ControlPoints(Curve=crv)  # -> Points, Weights, Knots

# ----
# 高度
# 固定点（相当于在冰内）
number_slider = Slider(1, range=0..10)

pdecon = Deconstruct(Point=cp.Points)  # -> XComponent, YComponent, ZComponent
smaller = SmallerThan(FirstNumber=pdecon.ZComponent, SecondNumber=number_slider)  # -> SmallerThan, OrEqualTo
# PE的直径
dispatch = Dispatch(List=cp.Points, DispatchPattern=smaller.SmallerThan)  # -> ListA, ListB
len = Length(Curve=crv)
pt = Point(flatten(dispatch.ListA))
ma = MassAddition(Input=len)  # -> Result, PartialResults
mcx = MultipleCurves(Curves=crv)  # -> Points, IndexA, IndexB, ParamA, ParamB

# ----
# FRP的直径
# ICE的直径
D = Slider(0, range=0..0.2)
division = Division(A=D, B="2")

multiplication = Multiplication(A=ma.Result, B="0")
lng = ListLength(List=mcx.Points)
D_2 = Slider(0.16, range=0..0.2)
t = Slider(0.05, range=0..0.1)
D_3 = Slider(0, range=0..0.1)
t_2 = Slider(0, range=0..0.01)
division_2 = Division(A=multiplication, B=lng)
multiplication_2 = Multiplication(A=division_2, B="1.4")
Y = UnitY(Factor=multiplication_2)
explode = Explode(Curve=crv, Recursive=True)  # -> Segments, Vertices
X = UnitX(Factor=multiplication_2)
explode_2 = Explode(Curve=explode.Segments, Recursive=True)  # -> Segments, Vertices

# ---- group: ICE
eval = Evaluate(F="D-t*2", D=D_2, t=t)
panel = Panel("7E9")
eval_2 = Evaluate(F="π*(x²-y²)/4", x=D_2, y=eval)
eval_3 = Evaluate(F="π*(x^4-y^4)/64", x=D_2, y=eval)
len_2 = Length(Curve=explode_2.Segments)
multiplication_3 = Multiplication(A=panel, B=eval_2)
multiplication_4 = Multiplication(A=panel, B=eval_3)
avr = Average(Input=flatten(len_2))
expression = Expression(x=multiplication_4, y=avr, Expression="x/y^2")
expression_2 = Expression(x=multiplication_3, y=avr, Expression="x/y")
panel_2 = Panel(expression)

# ---- group: FRP
eval_4 = Evaluate(F="D-t*2", D=D, t=division)
panel_3 = Panel("4E10")
eval_5 = Evaluate(F="π*(x²-y²)/4", x=D, y=eval_4)
len_3 = Length(Curve=explode_2.Segments)
eval_6 = Evaluate(F="π*(x^4-y^4)/64", x=D, y=eval_4)
avr_2 = Average(Input=flatten(len_3))
multiplication_5 = Multiplication(A=panel_3, B=eval_5)
multiplication_6 = Multiplication(A=panel_3, B=eval_6)
expression_3 = Expression(x=multiplication_6, y=avr_2, Expression="x/y^2")
expression_4 = Expression(x=multiplication_5, y=avr_2, Expression="x/y")
panel_4 = Panel(expression_3)

# ----
uforce = UnaryForce(Point=mcx.Points, Force=Y)
path_mapper = PathMapper(explode_2.Segments, source="{A;B;C}", target="{A;B}")
eval_7 = Evaluate(F="D-t*2", D=D_2, t=t)
eval_8 = Evaluate(F="D-t*2", D=D_3, t=t_2)
len_4 = Length(Curve=path_mapper)
eval_9 = Evaluate(F="D-t*2", D=D, t=division)
eval_10 = Evaluate(F="π*(x²-y²)/4", x=D_2, y=eval_7)
eval_11 = Evaluate(F="π*(x²-y²)/4", x=D_3, y=eval_8)
division_3 = Division(A=len_4, B="2")
eval_12 = Evaluate(F="π*(x²-y²)/4", x=D, y=eval_9)
end = EndPoints(Curve=path_mapper)  # -> Start, End
explode_3 = Explode(Curve=path_mapper, Recursive=True)  # -> Segments, Vertices
ins = InsertItems(List=division_3, Item="0", Indices="0", Wrap=True)
multiplication_7 = Multiplication(A="1.16", B=Slider(0, range=0..1))
item = ListItem(List=reverse(end.End), Index=0, Wrap=True)
addition = Addition(A=simplify(division_3), B=simplify(ins))
expression_5 = Expression(x=eval_11, y=addition, z="1000", Expression="x*y*z*9.8")
expression_6 = Expression(x=eval_10, y=addition, z="800", Expression="x*y*z*9.8")
expression_7 = Expression(x=eval_12, y=addition, z="2000", Expression="x*y*z*9.8")
merge = Merge(Data1=end.Start, Data2=item)
multiplication_8 = Multiplication(A=addition, B=multiplication_7)
pline = PolyLine(Vertices=merge, Closed=False)
addition_2 = Addition(A=expression_6, B=expression_5, C=multiplication_8, D=expression_7)
cp_2 = ControlPoints(Curve=pline)  # -> Points, Weights, Knots
addition_3 = Addition(A=expression_4, B=expression_2)
multiplication_9 = Multiplication(A=addition_2, B="1.0")
lng_2 = ListLength(List=cp_2.Points)
panel_5 = Panel(addition_2)
data = Data(lng_2)
cls = Closed(Curve=pline)  # -> Closed, Periodic
ma_2 = MassAddition(Input=flatten(addition_2))  # -> Result, PartialResults
dispatch_2 = Dispatch(List=pline, DispatchPattern=cls.Closed)  # -> ListA, ListB
cp_3 = ControlPoints(Curve=dispatch_2.ListA)  # -> Points, Weights, Knots
Z = UnitZ(Factor=expr("-x", multiplication_9))
item_2 = ListItem(List=reverse(cp_3.Points), Index=1, Wrap=True)  # -> flatten(Item)
item_3 = ListItem(List=cp_3.Points, Index=0, Wrap=True)  # -> flatten(Item)
item_4 = ListItem(List=cp_3.Points, Index=1, Wrap=True)  # -> flatten(Item)
dom = ConstructDomain(DomainStart=1, DomainEnd=expr("x-2", data))
dom_2 = ConstructDomain(DomainStart=2, DomainEnd=expr("x-1", data))
dom_3 = ConstructDomain(DomainStart=0, DomainEnd=expr("x-3", data))
uforce_2 = UnaryForce(Point=cp_2.Points, Force=Z)
subset = SubList(List=cp_2.Points, Domain=dom_3, Wrap=True)  # -> List, Index
subset_2 = SubList(List=cp_2.Points, Domain=dom, Wrap=True)  # -> List, Index
vec2pt = Vector2Pt(PointA=subset.List, PointB=subset_2.List, Unitize=False)  # -> Vector, Length
subset_3 = SubList(List=cp_2.Points, Domain=dom_2, Wrap=True)  # -> List, Index
vec2pt_2 = Vector2Pt(PointA=subset_2.List, PointB=subset_3.List, Unitize=False)  # -> Vector, Length
angle = Angle(VectorA=vec2pt.Vector, VectorB=vec2pt_2.Vector)  # -> Angle, Reflex
subtraction = Subtraction(A=angle.Reflex, B=3.141592654)
vec2pt_3 = Vector2Pt(PointA=item_4, PointB=item_3, Unitize=False)  # -> Vector, Length
vec2pt_4 = Vector2Pt(PointA=item_2, PointB=item_3, Unitize=False)  # -> Vector, Length
bend = Bend(Point1=item_2, Point2=item_3, Point3=item_4, BendStrength=expression_3, RestAngle=0)
vec2pt_5 = Vector2Pt(PointA=item_2, PointB=item_3, Unitize=False)  # -> Vector, Length
vec2pt_6 = Vector2Pt(PointA=item_4, PointB=item_3, Unitize=False)  # -> Vector, Length
springs = SpringsFromLine(
    Connection=explode_3.Segments,
    Stiffness=addition_3,
    Damping=10,
    RestLength=explode_3.Segments,
    UpperCutoff=0,
    LowerCutoff=0,
    Plasticity=0)
bend_2 = Bend(Point1=subset.List, Point2=subset_2.List, Point3=subset_3.List, BendStrength=expression, RestAngle=angle.Angle)
angle_2 = Angle(VectorA=vec2pt_4.Vector, VectorB=vec2pt_3.Vector)  # -> Angle, Reflex
angle_3 = Angle(VectorA=vec2pt_5.Vector, VectorB=vec2pt_6.Vector)  # -> Angle, Reflex
subtraction_2 = Subtraction(A=angle_3.Reflex, B=3.141592654)
bend_3 = Bend(Point1=item_2, Point2=item_3, Point3=item_4, BendStrength=expression, RestAngle=subtraction_2)
larger = LargerThan(FirstNumber=angle_2.Angle, SecondNumber="2.5")  # -> LargerThan, OrEqualTo
larger_2 = LargerThan(FirstNumber=angle_3.Angle, SecondNumber="2.5")  # -> LargerThan, OrEqualTo
bend_4 = Bend(Point1=subset.List, Point2=subset_2.List, Point3=subset_3.List, BendStrength=expression_3, RestAngle=0)
dispatch_3 = Dispatch(List=bend, DispatchPattern=larger.LargerThan)  # -> ListA, ListB
clean = CleanTree(RemoveNulls=True, RemoveInvalid=True, RemoveEmpty=False, Tree=dispatch_3.ListA)
dispatch_4 = Dispatch(List=bend_3, DispatchPattern=larger_2.LargerThan)  # -> ListA, ListB
clean_2 = CleanTree(RemoveNulls=True, RemoveInvalid=True, RemoveEmpty=False, Tree=dispatch_4.ListA)
kangaroo_settings = KangarooSettings(
    Tolerance=0.001,
    TimeStep=2e-05,
    SubIterations=10,
    Floor=True,
    Drag=1,
    Restitution=0.7,
    StaticFriction=30,
    KineticFriction=30,
    Settle=2,
    Tumble=1,
    Sound=False,
    Solver=0)
timer = Timer(TimerInterval=1, Target=kangaroo)  # disabled
kangaroo = KangarooPhysics(
    ForceObjects=flatten([springs, uforce_2, bend_4, uforce, clean, clean_2, bend_2]),
    AnchorPoints=pt,
    Settings=kangaroo_settings,
    Geometry=path_mapper,
    SimulationReset=Toggle(False))  # -> Out, Iterations, ParticlesOut, GeometryOut, KE
panel_6 = Panel(kangaroo.Iterations)
panel_7 = Panel(kangaroo.KE)
crv_2 = Curve(flatten(kangaroo.GeometryOut))
crv_3 = Curve(flatten(path_mapper))
crv_4 = Curve(kangaroo.GeometryOut)
end_2 = EndPoints(Curve=crv_4)  # -> Start, End
cp_4 = ControlPoints(Curve=crv_2)  # -> Points, Weights, Knots
cp_5 = ControlPoints(Curve=crv_3)  # -> Points, Weights, Knots
item_5 = ListItem(List=end_2.Start, Index=0, Wrap=True)
dist = Distance(PointA=cp_4.Points, PointB=cp_5.Points)
len_5 = Length(Curve=crv_2)
len_6 = Length(Curve=crv_3)
merge_2 = Merge(Data1=item_5, Data2=end_2.End)
avr_3 = Average(Input=dist)  # -> flatten(ArithmeticMean)
division_4 = Division(A=len_5, B=len_6)
cull_i = CullIndex(List=explode.Vertices, Indices="-1", Wrap=True)
shift = ShiftList(List=cull_i, Shift=2, Wrap=True)
shift_2 = ShiftList(List=cull_i, Shift=1, Wrap=True)
bnd = Bounds(Numbers=avr_3)
cull_i_2 = CullIndex(List=merge_2, Indices="-1", Wrap=True)
bnd_2 = Bounds(Numbers=division_4)
dedomain = DeconstructDomain(Domain=bnd)  # -> Start, End
dedomain_2 = DeconstructDomain(Domain=bnd_2)  # -> Start, End
shift_3 = ShiftList(List=cull_i_2, Shift=2, Wrap=True)
shift_4 = ShiftList(List=cull_i_2, Shift=1, Wrap=True)
circle = Circle3Pt(PointA=cull_i, PointB=shift_2, PointC=shift)  # -> Circle, Plane, simplify(Radius)
gradient = Gradient(
    LowerLimit=dedomain.Start,
    UpperLimit=dedomain.End,
    Parameter=avr_3,
    stops=[0: RGB(75, 0, 130), 0.112: RGB(39, 72, 161), 0.259: RGB(1, 192, 229), 0.394: RGB(18, 178, 90), 0.549: RGB(79, 186, 8), 0.696: RGB(220, 237, 32), 0.845: RGB(247, 159, 20), 1: RGB(242, 0, 0)])
gradient_2 = Gradient(
    LowerLimit=dedomain_2.Start,
    UpperLimit=dedomain_2.End,
    Parameter=division_4,
    stops=[0: RGB(75, 0, 130), 0.129: RGB(39, 72, 161), 0.261: RGB(1, 192, 229), 0.401: RGB(18, 178, 90), 0.548: RGB(79, 186, 8), 0.679: RGB(220, 237, 32), 0.806: RGB(247, 159, 20), 0.933: RGB(242, 0, 0)])
panel_8 = Panel(dedomain.End)
circle_2 = Circle3Pt(PointA=cull_i_2, PointB=shift_4, PointC=shift_3)  # -> Circle, Plane, simplify(Radius)
shift_5 = ShiftList(List=circle.Radius, Shift=-1, Wrap=True)
addition_4 = Addition(A=circle.Radius, B=shift_5)
shift_6 = ShiftList(List=circle_2.Radius, Shift=-1, Wrap=True)
division_5 = Division(A=addition_4, B=2)
addition_5 = Addition(A=circle_2.Radius, B=shift_6)
# 位移模拟
preview = CustomPreview(Geometry=crv_2, Shader=gradient)
# 轴力模拟
preview_2 = CustomPreview(Geometry=crv_2, Shader=gradient_2)
division_6 = Division(A=addition_5, B=2)
expression_8 = Expression(E=panel_3, D=D_2, r=division_5, R=division_6, Expression="E*D/2/(R*(r+D/2))")
bnd_3 = Bounds(Numbers=flatten(division_6))
subtraction_3 = Subtraction(A=division_5, B=division_6)
dedomain_3 = DeconstructDomain(Domain=bnd_3)  # -> Start, End
panel_9 = Panel("E*D*(r-R)/(R*(r+D))")
panel_10 = Panel(dedomain_3.Start)
multiplication_10 = Multiplication(A=subtraction_3, B=expression_8)
gradient_3 = Gradient(
    LowerLimit=1,
    UpperLimit=4,
    Parameter=division_6,
    stops=[0: RGB(234, 38, 0), 0.25: RGB(234, 126, 0), 0.5: RGB(254, 244, 84), 0.75: RGB(173, 203, 249), 1: RGB(75, 107, 169)])
abs = Absolute(Value=multiplication_10)
bar_graph = BarGraph(division_6, BarColor=RGB(255, 0, 90))
eval_13 = Evaluate(F="E*D/2/R", E=panel_3, D=D, R=division_6)
crv_5 = Curve(path_mapper)
panel_11 = Panel(abs)
len_7 = Length(Curve=crv_4)
len_8 = Length(Curve=crv_5)
subtraction_4 = Subtraction(A=len_7, B=len_8)
division_7 = Division(A=subtraction_4, B=len_8)
multiplication_11 = Multiplication(A=division_7, B=panel_3)
abs_2 = Absolute(Value=multiplication_11)
panel_12 = Panel(abs_2)
# 弯矩模拟
preview_3 = CustomPreview(Geometry=crv_4, Shader=gradient_3)
multiplication_12 = Multiplication(A=division_7, B=panel)
addition_6 = Addition(A=abs_2, B=eval_13)
bnd_4 = Bounds(Numbers=flatten(addition_6))
abs_3 = Absolute(Value=multiplication_12)
panel_13 = Panel(abs_3)
dedomain_4 = DeconstructDomain(Domain=bnd_4)  # -> Start, End
addition_7 = Addition(A=abs_3, B=abs)
panel_14 = Panel("5e8")
gradient_4 = Gradient(
    LowerLimit=dedomain_4.Start,
    UpperLimit=dedomain_4.End,
    Parameter=addition_6,
    stops=[0: RGB(75, 107, 169), 0.247: RGB(173, 203, 249), 0.5: RGB(254, 244, 84), 0.752: RGB(234, 126, 0), 1: RGB(234, 38, 0)])
number_slider_2 = Slider(0, range=0..100)
bnd_5 = Bounds(Numbers=flatten(addition_7))
panel_15 = Panel("5e6")
panel_16 = Panel(addition_7)
panel_17 = Panel(addition_6)
dedomain_5 = DeconstructDomain(Domain=bnd_5)  # -> Start, End
panel_18 = Panel(dedomain_4.End)
gradient_5 = Gradient(
    LowerLimit=dedomain_5.Start,
    UpperLimit=dedomain_5.End,
    Parameter=addition_7,
    stops=[0: RGB(75, 107, 169), 0.247: RGB(173, 203, 249), 0.5: RGB(254, 244, 84), 0.752: RGB(234, 126, 0), 1: RGB(234, 38, 0)])
preview_4 = CustomPreview(Geometry=crv_4, Shader=gradient_4)
panel_19 = Panel(dedomain_5.End)
createatts = CreateAttributes(Color=gradient_4, enableFullPath=False)
preview_5 = CustomPreview(Geometry=crv_4, Shader=gradient_5)
X_2 = UnitX(Factor=Slider(10, range=0..10))
move = Move(Geometry=crv_4, Motion=X_2)  # -> Geometry, Transform
createatts_2 = CreateAttributes(Color=gradient_5, enableFullPath=False)
bake = BakeGeometry(Bake=Button(), Geometry=move.Geometry, Attributes=createatts, DeleteOldBakes=False, PreserveTrees=False)
X_3 = UnitX(Factor=Slider(30, range=0..100))
move_2 = Move(Geometry=crv_4, Motion=X_3)  # -> Geometry, Transform
bake_2 = BakeGeometry(Bake=Button(), Geometry=move_2.Geometry, Attributes=createatts_2, DeleteOldBakes=False, PreserveTrees=False)
